# Requirement set requirements_Software_Low_Level (R2024a)

## 1 [requirements_Software_Low__Level!Planilha1] References to requirements_Software_Low__Level.xlsx (Planilha1) (Container)
Read-only references to Microsoft Excel document.

### 1.1 [SW-LL-FR-01] Engine Stop - Enable
The software must set EngineStopRequest =TRUE when SS_Enabled == TRUE AND GearPosition == D AND BrakeStatus == PRESSED (BrakePedalPosition ≥ 5%) AND VehicleSpeed ≤ 5 km/h AND AutostopAllowed ==TRUE.

### 1.2 [SW-LL-FR-02] Engine Stop - Enable
The software must allow AutostopAllowed = TRUE when SpeedThresholdReached == TRUE, where SpeedThresholdReached is set when VehicleSpeed > 8 km/h is detected in the current drive cycle

### 1.3 [SW-LL-FR-03] Engine Stop - Inhibition
The software must set AutostopAllowed = FALSE when GearPosition != D

### 1.4 [SW-LL-FR-04] Engine Stop - Inhibition
The software must set AutostopAllowed = FALSE when InclinationAngle > INCLINATION_THRESHOLD (15%)

### 1.5 [SW-LL-FR-05] Engine Stop - Inhibition
The software must set AutostopAllowed = FALSE when DoorStatus != CLOSED

### 1.6 [SW-LL-FR-06] Engine Stop - Inhibition
The software must set AutostopAllowed = FALSE when SeatbeltStatus != FASTENED

### 1.7 [SW-LL-FR-07] Engine Restart - Autostart
The software must set EngineRestartRequest = TRUE when AutostopActive == TRUE AND AcceleratorStatus == PRESSED (WHEN Accelerator PedalPosition > 5%)

### 1.8 [SW-LL-FR-08] Engine Restart - Autostart
The software must set EngineRestartRequest = TRUE when AutostopActive == TRUE AND BrakeStatus == RELEASED (WHEN BrakePedalPosition < 5%)

### 1.9 [SW-LL-FR-09] Engine Restart - Autostart
The software must set EngineRestartRequest = TRUE when AutostopActive == TRUE AND GearPosition != D

### 1.10 [SW-LL-FR-10] Engine Restart - Autostart
The software must set EngineRestartRequest = TRUE when AutostopActive == TRUE AND TIME_AUTO_STOP >= 180000 ms

### 1.11 [SW-LL-FR-11] Enable / Disable
The software must set SS_Enabled = TRUE when Start_Ignition == TRUE

### 1.12 [SW-LL-FR-12] Enable / Disable
The software must toggle SS_Enabled when ButtonInput rising edge detected AND ButtonInput stable >= T_debounce ms (50ms)

### 1.13 [SW-LL-FR-13] Enable / Disable
The software must reject button input when ButtonInput stable < T_debounce ms (50ms)

### 1.14 [SW-LL-FR-14] Enable / Disable
The software must set AutostopAllowed = FALSE AND AutostartAllowed = FALSE when SS_Enabled == FALSE

### 1.15 [SW-LL-FR-15] Cluster
The software must send a display message for 3s to the cluster when SS_Enabled != SS_Enabled_prev

### 1.16 [SW-LL-FR-16] Unavailable
The software must set SS_Unavailable = TRUE when AutoStopAllowed == FALSE or AutoStartAllowed == FALSE

### 1.17 [SW-LL-FR-17] Cluster
The software must command the instrument cluster to display the Start/Stop Unavailable indication when SS_Unavailable == TRUE

### 1.18 [SW-LL-FR-18] Cluster
The software must command the instrument cluster to clear the Start/Stop Unavailable indication when SS_Unavailable == FALSE

### 1.19 [SW-LL-FR-19] Cluster
The software must display AUTOSTOP_ACTIVE indicator in the cluster when AutostopActive == TRUE

### 1.20 [SW-LL-FR-20] HMI
The software must set the Start/Stop HMI LED to OFF when SS_Enabled = TRUE

### 1.21 [SW-LL-FR-21] HMI
The software must set the Start/Stop HMI LED to ON when SS_Enabled = FALSE

### 1.22 [SW-LL-FR-22] HMI
The software must send a led update command to the HMI led when SS_Enabled != SS_Enabled_prev

### 1.23 [SW-LL-FR-23] CO₂ Estimation
The software must increment TIME_AUTO_STOP by 100ms every control cycle when AutostopActive == TRUE

### 1.24 [SW-LL-FR-24] CO₂ Estimation
The software must reset TIME_AUTO_STOP = 0 when IgnitionOFF == TRUE

### 1.25 [SW-LL-FR-25] CO₂ Estimation
The software must compute CO2_AVOIDED = TIME_AUTO_STOP × WLTP_IDLE_FACTOR when AutostopActive == TRUE

### 1.26 [SW-LL-FR-26] CO₂ Estimation
The software must command the cluster to display CO2_AVOIDED when AutostopActive == TRUE

### 1.27 [SW-LL-FR-27] CO₂ Estimation
The software must command the cluster to hide CO2_AVOIDED when AutostopActive == FALSE

### 1.28 [SW-LL-FR-28] Safety Stop
The software must set SafeStop = TRUE when (DoorStatus == OPEN or SeatBeltStatus == UNFASTENED) and AutoStopActive == TRUE

### 1.29 [SW-LL-FR-29] Engine Restart - Inhibition
The software must inhibith AutoStart when SafeStop == TRUE

### 1.30 [SW-LL-FR-30] Engine Restart - Autostart
The software must set EngineRestartRequest = TRUE when AnyAutoRestartConditions == TRUE and SafeStop == FALSE